# Dynamo graph all_elements.dyn "all elements" (Dynamo 2.10.1.3976)
# packages: MEPover 2020.6.2

# group: Import all the elements
categories = Categories("OST_PipeCurves")
all_elements_of_category = ElementsOfCategory(Category=categories)

# group: Get original information
id = Element.Id(element=all_elements_of_category)
mep_connector_info = Custom[MEP connector info](all_elements_of_category)  # package MEPover; Returns location, connector info and connected elements
string = StringInput("Length")
getParameterValueByName = Element.GetParameterValueByName(element=all_elements_of_category, parameterName=string)
string_2 = StringInput("Externa_diameter")
getParameterValueByName_2 = Element.GetParameterValueByName(element=all_elements_of_category, parameterName=string_2)

# group: Intergation
transpose = List.Transpose(lists=mep_connector_info.Points)
code_block = CodeBlock(list=transpose) { list[0]; list[1]; }
get_midpoints = Python(IN[0]=code_block.out0, IN[1]=code_block.out1)  # IronPython2
# ---------- get_midpoints.python (18 lines) ----------
# 加载 Python Standard 和 DesignScript 库
import sys
import clr
clr.AddReference('ProtoGeometry')
from Autodesk.DesignScript.Geometry import Point

# 该节点的输入内容将存储为 IN 变量中的一个列表。
point1List = IN[0]
point2List = IN[1]

# 将代码放在该行下面

midpoints = []
for p1, p2 in zip(point1List, point2List):
    midpoints.append(Point.ByCoordinates((p1.X + p2.X) / 2, (p1.Y + p2.Y) / 2, (p1.Z + p2.Z) / 2))

# 将输出内容指定给 OUT 变量。
OUT = midpoints
# ----------------------------------------
X = Point.X(point=get_midpoints)
Y = Point.Y(point=get_midpoints)
Z = Point.Z(point=get_midpoints)
code_block_2 = CodeBlock { 1/2; }
mul = getParameterValueByName_2 * code_block_2
list_create = List.Create(item0=id, item1=X, item2=Y, item3=Z, item4=getParameterValueByName, item5=mul)

# group: Export
file_path = Filename(".\info.xlsx")
code_block_3 = CodeBlock { "Sheet1"; }
code_block_4 = CodeBlock { 0; }
code_block_5 = CodeBlock { ["ID","X","Y","Z","L","R"]; }
transpose_2 = List.Transpose(lists=list_create)
addItemToFront = List.AddItemToFront(item=code_block_5, list=transpose_2)
transpose_3 = List.Transpose(lists=addItemToFront)
boolean = BoolSelector(true)
exportExcel = Data.ExportExcel(filePath=file_path, sheetName=code_block_3, startRow=code_block_4, startCol=code_block_4, data=transpose_3, overWrite=boolean)
transpose_4 = List.Transpose(lists=code_block_5)
