# Dynamo graph single_element.dyn "single element" (Dynamo 2.10.1.3976)
# packages: MEPover 2020.6.2

# group: Select the element and get information
select_model_element = DSModelElementSelection()  # 1 picked in the model
mep_connector_info = Custom[MEP connector info](select_model_element)  # package MEPover; Returns location, connector info and connected elements
transpose = List.Transpose(lists=mep_connector_info.Points)

# group: Intergation
id = Element.Id(element=select_model_element)
code_block = CodeBlock(list=transpose) { list[0]; list[1]; }
get_midpoint = Python(IN[0]=code_block.out0, IN[1]=code_block.out1)  # IronPython2
# ---------- get_midpoint.python (18 lines) ----------
# 加载 Python Standard 和 DesignScript 库
import sys
import clr
clr.AddReference('ProtoGeometry')
from Autodesk.DesignScript.Geometry import Point

# 该节点的输入内容将存储为 IN 变量中的一个列表。
point1 = IN[0]
point2 = IN[1]

# 将代码放在该行下面
midpoint = Point.ByCoordinates((point1.X + point2.X) / 2, (point1.Y + point2.Y) / 2, (point1.Z + point2.Z) / 2)

OUT = midpoint


# 将输出内容指定给 OUT 变量。
OUT = midpoint
# ----------------------------------------
X = Point.X(point=get_midpoint)
Y = Point.Y(point=get_midpoint)
Z = Point.Z(point=get_midpoint)
string = StringInput("Length")
getParameterValueByName = Element.GetParameterValueByName(element=select_model_element, parameterName=string)
string_2 = StringInput("External_diameter")
getParameterValueByName_2 = Element.GetParameterValueByName(element=select_model_element, parameterName=string_2)
list_create = List.Create(item0=id, item1=X, item2=Y, item3=Z, item4=getParameterValueByName, item5=getParameterValueByName_2)

# group: Export
file_path = Filename(".\single_info.xlsx")
code_block_2 = CodeBlock { "Sheet1"; }
code_block_3 = CodeBlock { 0; }
code_block_4 = CodeBlock { ["ID","X","Y","Z","L","V"]; }
transpose_2 = List.Transpose(lists=list_create@L2)
addItemToFront = List.AddItemToFront(item=code_block_4, list=transpose_2)
transpose_3 = List.Transpose(lists=addItemToFront)
boolean = BoolSelector(true)
exportExcel = Data.ExportExcel(filePath=file_path, sheetName=code_block_2, startRow=code_block_3, startCol=code_block_3, data=transpose_3, overWrite=boolean)
