# Dynamo graph single_element_modified.dyn "single element_modified" (Dynamo 2.10.1.3976)
# packages: MEPover 2020.6.2

# group: Select the element and get information
select_model_element = DSModelElementSelection()  # 1 picked in the model
mep_connector_info = Custom[MEP connector info](select_model_element)  # package MEPover; Returns location, connector info and connected elements

# group: Update pipe diameter
string = StringInput("External_diameter")
number = DoubleInput(150)
setParameterByName = Element.SetParameterByName(element=select_model_element, parameterName=string, value=number)

# group: Update pipe height (intermediate elevation)
string_2 = StringInput("Mid_height")
number_2 = DoubleInput(2000)
setParameterByName_2 = Element.SetParameterByName(element=select_model_element, parameterName=string_2, value=number_2)

# group: Update pipe length by percentage
number_slider = DoubleSlider(1.03, range=0.5..2 step 0.01)
python_script = Python(IN[0]=select_model_element, IN[1]=number_slider)  # IronPython2
# ---------- python_script.python (58 lines) ----------
import clr
clr.AddReference('ProtoGeometry')
from Autodesk.DesignScript.Geometry import *

clr.AddReference('RevitAPI')
from Autodesk.Revit.DB import *

clr.AddReference('RevitServices')
from RevitServices.Persistence import DocumentManager
from RevitServices.Transactions import TransactionManager

# Get input and document
doc = DocumentManager.Instance.CurrentDBDocument
pipes = UnwrapElement(IN[0])
length_factor = IN[1] if len(IN) > 1 else 1.1  # Default increase by 10%

if not isinstance(pipes, list):
    pipes = [pipes]

debug_info = []

def ModifyPipeLength(pipe, length_factor):
    try:
        curve = pipe.Location.Curve
        if isinstance(curve, Line):
            start_point = curve.GetEndPoint(0)
            end_point = curve.GetEndPoint(1)
            direction = (end_point - start_point).Normalize()
            new_length = curve.Length * length_factor
            new_end_point = start_point + direction * new_length
            new_line = Line.CreateBound(start_point, new_end_point)
            pipe.Location.Curve = new_line
            debug_info.append("Pipe %s length modified: %s -> %s" % (pipe.Id, curve.Length, new_length))
            return True
        else:
            debug_info.append("Pipe %s is not a straight line, cannot modify length" % pipe.Id)
            return False
    except Exception as e:
        debug_info.append("Error modifying pipe %s: %s" % (pipe.Id, str(e)))
        return False

# Start transaction
TransactionManager.Instance.EnsureInTransaction(doc)

modified_pipes = []
for pipe in pipes:
    debug_info.append("Processing pipe: %s" % pipe.Id)
    if ModifyPipeLength(pipe, length_factor):
        modified_pipes.append(pipe)
        debug_info.append("Successfully modified pipe: %s" % pipe.Id)
    else:
        debug_info.append("Failed to modify pipe: %s" % pipe.Id)

# Complete transaction
TransactionManager.Instance.TransactionTaskDone()

# Output
OUT = modified_pipes, debug_info
# ----------------------------------------
list_create = List.Create(item0=python_script, item1=python_script)

# group: Update pipe length according to start and end coordinates
transpose = List.Transpose(lists=mep_connector_info.Points)
code_block = CodeBlock(list=transpose) { list[0]; list[1]; }
number_3 = DoubleInput(1)
byCoordinates = Point.ByCoordinates(x=number_3, y=number_3, z=number_3)
number_4 = DoubleInput(5)
byCoordinates_2 = Point.ByCoordinates(x=number_4, y=number_4, z=number_4)
python_script_2 = Python(IN[0]=select_model_element, IN[1]=code_block.out0, IN[2]=code_block.out1, IN[3]=byCoordinates, IN[4]=byCoordinates_2)  # IronPython2
# ---------- python_script_2.python (83 lines) ----------
import clr
clr.AddReference('ProtoGeometry')
from Autodesk.DesignScript.Geometry import *

clr.AddReference('RevitAPI')
from Autodesk.Revit.DB import *

clr.AddReference('RevitServices')
from RevitServices.Persistence import DocumentManager
from RevitServices.Transactions import TransactionManager

# Get input and document
doc = DocumentManager.Instance.CurrentDBDocument
pipes = UnwrapElement(IN[0])
original_start_points = IN[1]  # List of original start points
original_end_points = IN[2]    # List of original end points
new_start_points = IN[3]       # List of new start points
new_end_points = IN[4]         # List of new end points

if not isinstance(pipes, list):
    pipes = [pipes]

debug_info = []

def ModifyPipeByCoordinates(pipe, original_start, original_end, new_start, new_end):
    try:
        # Calculate the displacement vector
        displacement_start = XYZ(new_start.X - original_start.X, 
                                 new_start.Y - original_start.Y, 
                                 new_start.Z - original_start.Z)
        displacement_end = XYZ(new_end.X - original_end.X, 
                               new_end.Y - original_end.Y, 
                               new_end.Z - original_end.Z)

        # Get current pipe data
        old_curve = pipe.Location.Curve
        old_start = old_curve.GetEndPoint(0)
        old_end = old_curve.GetEndPoint(1)

        # Calculate new start and end points
        new_start_xyz = old_start.Add(displacement_start)
        new_end_xyz = old_end.Add(displacement_end)

        # Create new line
        new_line = Line.CreateBound(new_start_xyz, new_end_xyz)
        
        # Modify pipe location
        pipe.Location.Curve = new_line
        
        debug_info.append("Pipe %s modified:" % pipe.Id)
        debug_info.append("  Old start: (%f, %f, %f)" % (old_start.X, old_start.Y, old_start.Z))
        debug_info.append("  Old end: (%f, %f, %f)" % (old_end.X, old_end.Y, old_end.Z))
        debug_info.append("  New start: (%f, %f, %f)" % (new_start_xyz.X, new_start_xyz.Y, new_start_xyz.Z))
        debug_info.append("  New end: (%f, %f, %f)" % (new_end_xyz.X, new_end_xyz.Y, new_end_xyz.Z))
        
        return True
    except Exception as e:
        debug_info.append("Error modifying pipe %s: %s" % (pipe.Id, str(e)))
        return False

# Start transaction
TransactionManager.Instance.EnsureInTransaction(doc)

modified_pipes = []
for i in range(len(pipes)):
    pipe = pipes[i]
    original_start = original_start_points[i] if isinstance(original_start_points, list) else original_start_points
    original_end = original_end_points[i] if isinstance(original_end_points, list) else original_end_points
    new_start = new_start_points[i] if isinstance(new_start_points, list) else new_start_points
    new_end = new_end_points[i] if isinstance(new_end_points, list) else new_end_points
    
    debug_info.append("Processing pipe: %s" % pipe.Id)
    if ModifyPipeByCoordinates(pipe, original_start, original_end, new_start, new_end):
        modified_pipes.append(pipe)
        debug_info.append("Successfully modified pipe: %s" % pipe.Id)
    else:
        debug_info.append("Failed to modify pipe: %s" % pipe.Id)

# Complete transaction
TransactionManager.Instance.TransactionTaskDone()

# Output
OUT = modified_pipes, debug_info
# ----------------------------------------
list_create_2 = List.Create(item0=python_script_2, item1=python_script_2)

# group: Reconstruct pipes
code_block_2 = CodeBlock { 100; 600; }
byCoordinates_3 = Point.ByCoordinates(x=code_block_2.out0, y=code_block_2.out0, z=code_block_2.out0)
byCoordinates_4 = Point.ByCoordinates(x=code_block_2.out1, y=code_block_2.out1, z=code_block_2.out1)
byStartPointEndPoint = Line.ByStartPointEndPoint(startPoint=byCoordinates_3, endPoint=byCoordinates_4)
element_types = ElementTypes("Pipe")
all_elements_of_type = ElementsOfType(element_type=element_types)
code_block_3 = CodeBlock(IN=all_elements_of_type) { IN[0]; }
element_types_2 = ElementTypes("PipingSystemType")
all_elements_of_type_2 = ElementsOfType(element_type=element_types_2)
code_block_4 = CodeBlock(IN=all_elements_of_type_2) { IN[0]; }
levels = Levels("标高 1")
number_5 = DoubleInput(300)
byLines = Custom[Pipe.ByLines](Lines=byStartPointEndPoint, PipeType=code_block_3, SystemType=code_block_4, level=levels, Diameter=number_5)  # package MEPover; Creates a pipe by Line, PipeType, SystemType, Level and Diameter
watch = Watch(byLines)
